# Grasshopper definition getCvsIc.gh (Grasshopper 1.0.7)
# plug-ins: SectionTools

geo = Geometry([<brep referenced from the Rhino model> x3])
Y = UnitY(Factor=1)
secprops = SectionProperties(Sections=geo)  # -> Area, Centroid, Moments
rot3d = Rotate3D(Geometry=geo, Angle=1.570796327, Center=secprops.Centroid, Axis=Y)  # -> Geometry, Transform
pt = ConstructPoint(XCoordinate=0, YCoordinate=0, ZCoordinate=0)
# From Section 2 of the paper,
# it shows that the transformed moment of inertia does not include the post tension wire ropes.
rotate = Rotate(Geometry=rot3d.Geometry, Angle=1.570796327, Plane=secprops.Centroid)  # -> Geometry, Transform
vec2pt = Vector2Pt(PointA=secprops.Centroid, PointB=pt, Unitize=False)  # -> Vector, Length
# Input geometry of the pixel section
move = Move(Geometry=rotate.Geometry, Motion=vec2pt.Vector)  # -> Geometry, Transform

number_slider = Slider(5, range=0..10)
number_slider_2 = Slider(10, range=0..10)
pt_2 = ConstructPoint(XCoordinate=number_slider, YCoordinate=number_slider_2, ZCoordinate=0)
expression = Expression(b=number_slider, h=number_slider_2, Expression="b*h^3/12")
expression_2 = Expression(b=number_slider_2, h=number_slider, Expression="b*h^3/12")
rec_2pt = Rectangle2Pt(Plane=PlaneXY(0, 0, 0), PointA=Point(0, 0, 0), PointB=pt_2, Radius=0)  # -> Rectangle, Length
iy = Panel(expression_2)
ix = Panel(expression)

geo_2 = Geometry(move.Geometry)
explode = Explode(Curve=geo_2, Recursive=True)  # -> Segments, flatten(Vertices)
pdecon = Deconstruct(Point=explode.Vertices)  # -> XComponent, YComponent, ZComponent
number_slider_3 = Slider(148, range=0..300)
sort = SortList(Keys=pdecon.XComponent, ValuesA=explode.Vertices)  # -> Keys, ValuesA
sort_2 = SortList(Keys=pdecon.YComponent, ValuesA=explode.Vertices)  # -> Keys, ValuesA
item = ListItem(List=sort_2.ValuesA, Index=0, Wrap=True)  # -> Item1, Item
item_2 = ListItem(List=sort.ValuesA, Index=0, Wrap=True)
series = Series(Start=0, Step=1, Count=Slider(230, range=0..1000))
pdecon_2 = Deconstruct(Point=item.Item1)  # -> XComponent, YComponent, ZComponent
pdecon_3 = Deconstruct(Point=item_2)  # -> XComponent, YComponent, ZComponent
num = Number(series)
subtraction = Subtraction(A=pdecon_2.YComponent, B=num)
pt_3 = ConstructPoint(XCoordinate=expr("-x", pdecon_3.XComponent), YCoordinate=pdecon_2.YComponent, ZCoordinate=pdecon_2.ZComponent)
pt_4 = ConstructPoint(XCoordinate=pdecon_3.XComponent, YCoordinate=subtraction, ZCoordinate=pdecon_2.ZComponent)
rec_2pt_2 = Rectangle2Pt(Plane=PlaneXY(0, 0, 0), PointA=pt_4, PointB=pt_3, Radius=0)  # -> Rectangle, Length
boundary = BoundarySurfaces(Edges=graft(rec_2pt_2.Rectangle))
item_3 = ListItem(List=geo_2, Index=0, Wrap=True)  # -> Item, Item1, Item2
rint = RegionIntersection(CurvesA=boundary, CurvesB=item_3.Item)
rint_2 = RegionIntersection(CurvesA=boundary, CurvesB=item_3.Item1)
rint_3 = RegionIntersection(CurvesA=boundary, CurvesB=item_3.Item2)
cut_geo = Geometry([rint, rint_2, rint_3])
amoments = AreaMoments(Geometry=cut_geo)  # -> Area, Centroid, Inertia, InertiaError, Secondary, SecondaryError, Gyration
ma = MassAddition(Input=amoments.Area)  # -> Result, PartialResults
pdecon_4 = Deconstruct(Point=amoments.Inertia)  # -> XComponent, YComponent, ZComponent
pdecon_5 = Deconstruct(Point=amoments.Centroid)  # -> XComponent, YComponent, ZComponent
multiplication = Multiplication(A=amoments.Area, B=amoments.Centroid)
ma_2 = MassAddition(Input=multiplication)  # -> Result, PartialResults
total_concrete_area_mm2 = Panel(ma.Result)
y_pos = Number(pdecon_5.YComponent)
division = Division(A=ma_2.Result, B=ma.Result)
pdecon_6 = Deconstruct(Point=division)  # -> XComponent, YComponent, ZComponent
subtraction_2 = Subtraction(A=pdecon_6.YComponent, B=y_pos)
avr = Average(Input=amoments.Centroid)
dist = Distance(PointA=avr, PointB=amoments.Centroid)
sqr = Square(Value=subtraction_2)
multiplication_2 = Multiplication(A=sqr, B=amoments.Area)
sqr_2 = Square(Value=dist)
addition = Addition(A=multiplication_2, B=pdecon_4.XComponent)
multiplication_3 = Multiplication(A=amoments.Area, B=sqr_2)
ma_3 = MassAddition(Input=addition)  # -> Result, PartialResults
num_2 = Number(flatten(ma_3.Result))
addition_2 = Addition(A=multiplication_3, B=pdecon_4.XComponent)
graft = GraftTree(Tree=num_2, IncludeEmptyLists=True, IncludeNullItems=True)
num_3 = Number(graft(num))
concat = Concatenate(FragmentA=graft, FragmentB=num)
ma_4 = MassAddition(Input=addition_2)  # -> Result, PartialResults
panel = Panel(concat)
panel_2 = Panel(ma_3.Result)
panel_3 = Panel([graft, num_3])
panel_4 = Panel(ma_4.Result)
addition_3 = Addition(A=ma_4.Result)
panel_5 = Panel(addition_3)
